# Grasshopper definition 01_compas-timber.ghx (Grasshopper 1.0.8)

list = ValueList({"1": 0, "2": 1, "3": 2, "4": 3}, selected="4")
list_2 = ValueList({"start", "end"}, selected="start")
lap = Python3Script(
    face_index=list,
    orientation=list_2,
    start_x=Slider(0.67, range=0..1),
    start_y=Slider(0.04, range=0..1),
    angle=Slider(90.06, range=0.1..179),
    inclination=Slider(90.3, range=0.1..179),
    slope=Slider(-1.42, range=-89..89),
    length=Slider(0.06, range=0..0.4),
    width=Slider(0.062, range=0..0.4),
    depth=Slider(0.083, range=0..0.4))  # -> processing; inputs face_index: Int32, orientation: String, start_x: Double, start_y: Double, angle: Double, inclination: Double, slope: Double, length: Double, width: Double, depth: Double, lead_angle_parallel: Boolean, lead_angle: Double, lead_inclination_parallel: Boolean, lead_inclination: Double
# ---------- lap: Python ----------
# venv: bit2beam_2026
import Grasshopper  # noqa: F401

from compas_timber.fabrication import Lap
from compas_timber.fabrication import OrientationType


class LapComponent(Grasshopper.Kernel.GH_ScriptInstance):
    def RunScript(self,
            face_index: int,
            orientation: str,
            start_x: float,
            start_y: float,
            angle: float,
            inclination: float,
            slope: float,
            length: float,
            width: float,
            depth: float,
            lead_angle_parallel: bool,
            lead_angle: float,
            lead_inclination_parallel: bool,
            lead_inclination: float):
        # ── Defaults ──────────────────────────────────────────────────────────
        if orientation is None:
            orientation = OrientationType.START
        else:
            orientation = orientation.strip().lower()
            if orientation not in (OrientationType.START, OrientationType.END):
                self.AddRuntimeMessage(
                    Grasshopper.Kernel.GH_RuntimeMessageLevel.Error,
                    "orientation must be 'start' or 'end'.",
                )
                return None

        start_x = float(start_x) if start_x is not None else 0.0
        start_y = float(start_y) if start_y is not None else 0.0
        angle = float(angle) if angle is not None else 90.0
        inclination = float(inclination) if inclination is not None else 90.0
        slope = float(slope) if slope is not None else 0.0
        length = float(length) if length is not None else 200.0
        width = float(width) if width is not None else 50.0
        depth = float(depth) if depth is not None else 40.0
        lead_angle_parallel = bool(lead_angle_parallel) if lead_angle_parallel is not None else True
        lead_angle = float(lead_angle) if lead_angle is not None else 90.0
        lead_inclination_parallel = bool(lead_inclination_parallel) if lead_inclination_parallel is not None else True
        lead_inclination = float(lead_inclination) if lead_inclination is not None else 90.0

        # ── Create processing ─────────────────────────────────────────────────
        processing = Lap(
            orientation=orientation,
            start_x=start_x,
            start_y=start_y,
            angle=angle,
            inclination=inclination,
            slope=slope,
            length=length,
            width=width,
            depth=depth,
            lead_angle_parallel=lead_angle_parallel,
            lead_angle=lead_angle,
            lead_inclination_parallel=lead_inclination_parallel,
            lead_inclination=lead_inclination,
            ref_side_index=face_index
        )

        return processing
# ---------- end lap ----------

list_3 = ValueList({"1": 0, "2": 1, "3": 2, "4": 3}, selected="2")
drilling = Python3Script(
    face_index=list_3,
    start_x=Slider(0.88, range=0..1),
    start_y=Slider(0.04, range=0..1),
    angle=Slider(90.06, range=0.1..179),
    inclination=Slider(90.3, range=0.1..179),
    depth_limited=Toggle(False),
    depth=Slider(0.04, range=0..1),
    diameter=Slider(0.03, range=0..1))  # -> processing; inputs face_index: Int32, start_x: Double, start_y: Double, angle: Double, inclination: Double, depth_limited: Boolean, depth: Double, diameter: Double
# ---------- drilling: Python ----------
# venv: cbit2beam_2026

import Grasshopper  # noqa: F401

from compas_timber.fabrication import Drilling


class DrillingComponent(Grasshopper.Kernel.GH_ScriptInstance):
    def RunScript(self,
            face_index: int,
            start_x: float,
            start_y: float,
            angle: float,
            inclination: float,
            depth_limited: bool,
            depth: float,
            diameter: float):
        # ── Defaults ──────────────────────────────────────────────────────────
        start_x = float(start_x) if start_x is not None else 0.0
        start_y = float(start_y) if start_y is not None else 0.0
        angle = float(angle) if angle is not None else 0.0
        inclination = float(inclination) if inclination is not None else 90.0
        depth_limited = bool(depth_limited) if depth_limited is not None else False
        depth = float(depth) if depth is not None else 50.0
        diameter = float(diameter) if diameter is not None else 20.0

        # ── Create processing ─────────────────────────────────────────────────
        processing = Drilling(
            start_x=start_x,
            start_y=start_y,
            angle=angle,
            inclination=inclination,
            depth_limited=depth_limited,
            depth=depth,
            diameter=diameter,
            ref_side_index=face_index
        )

        return processing
# ---------- end drilling ----------

# ----
# Beams - From centerlines
curve = Curve([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])
ct_beam = Python3Script(lines=curve)  # -> beams, geo; inputs lines: list of Line
# ---------- ct_beam: Python ----------
# venv: bit2beam_2026

from compas.scene import Scene
from compas_rhino.conversions import line_to_compas
from compas_timber.elements import Beam

width = 0.06
height = 0.08
z_vector = (0, 0, 1)

beams = []

for line in lines:
    beam = Beam.from_centerline(line_to_compas(line), width, height, z_vector)
    beams.append(beam)
    
geo = [beam.geometry for beam in beams]
# ---------- end ct_beam ----------
compas_draw = COMPASDraw(cg=ct_beam.geo)  # -> rg
#   port cg: The COMPAS geometry or datastructure to be drawn.
#   port rg: The Rhino geometry object.
# ---------- compas_draw: Python ----------
# venv: caadria_b01
"""
Draws COMPAS geometry in Grasshopper.
"""

from typing import Any

import Grasshopper

from compas.scene import SceneObject


class CompasToRhinoGeometry(Grasshopper.Kernel.GH_ScriptInstance):
    def RunScript(self, cg):
        if not cg:
            return None

        return SceneObject(item=cg).draw()
# ---------- end compas_draw ----------
panel = Panel(ct_beam.beams)

list_4 = ValueList({"start", "end"}, selected="start")
jackraftercut = Python3Script(
    orientation=list_4,
    start_x=Slider(0.34, range=0..1),
    start_y=Slider(0, range=0..1),
    start_depth=Slider(0, range=0..0.08),
    angle=Slider(66.91, range=0.1..179),
    inclination=Slider(80.12, range=0.1..179))  # -> processing; inputs orientation: String, start_x: Double, start_y: Double, start_depth: Double, angle: Double, inclination: Double
# ---------- jackraftercut: Python ----------
# venv: bit2beam_2026
import Grasshopper  # noqa: F401

from compas_timber.fabrication import JackRafterCut
from compas_timber.fabrication import OrientationType


class JackRafterCutComponent(Grasshopper.Kernel.GH_ScriptInstance):
    def RunScript(self,
            orientation: str,
            start_x: float,
            start_y: float,
            start_depth: float,
            angle: float,
            inclination: float):

        if orientation is None:
            orientation = OrientationType.START
        else:
            orientation = orientation.strip().lower()
            if orientation not in (OrientationType.START, OrientationType.END):
                self.AddRuntimeMessage(
                    Grasshopper.Kernel.GH_RuntimeMessageLevel.Error,
                    "orientation must be 'start' or 'end'.",
                )
                return None

        start_x = float(start_x) if start_x is not None else 0.0
        start_y = float(start_y) if start_y is not None else 0.0
        start_depth = float(start_depth) if start_depth is not None else 0.0
        angle = float(angle) if angle is not None else 90.0
        inclination = float(inclination) if inclination is not None else 90.0

        # ── Create processing ─────────────────────────────────────────────────
        processing = JackRafterCut(
            orientation=orientation,
            start_x=start_x,
            start_y=start_y,
            start_depth=start_depth,
            angle=angle,
            inclination=inclination,
        )

        return processing
# ---------- end jackraftercut ----------

merge = Merge()

# ----
# Beams - With Processings
curve_2 = Curve([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])
ct_beam_2 = Python3Script(lines=curve_2, beam_to_modify=Slider(0, range=0..2), processings=merge)  # -> beams, processed; inputs lines: list of Line, beam_to_modify: Int32, processings: list
# ---------- ct_beam_2: Python ----------
# venv: bit2beam_2026

from compas.scene import Scene
from compas_rhino.conversions import line_to_compas
from compas_timber.elements import Beam

width = 0.06
height = 0.08
z_vector = (0, 0, 1)

# Create beams
beams = []
for line in lines:
    beam = Beam.from_centerline(line_to_compas(line), width, height, z_vector)
    beams.append(beam)

selected_beam = beams[beam_to_modify]


if processings:
    processings = [p for p in processings if p is not None]
    selected_beam.add_features(processings)

beams = [beam.geometry for beam in beams]
processed = selected_beam.geometry
# ---------- end ct_beam_2 ----------
compas_draw_2 = COMPASDraw(cg=ct_beam_2.processed)  # -> rg; same code as compas_draw
compas_draw_3 = COMPASDraw(cg=ct_beam_2.beams)  # -> rg; same code as compas_draw

lines_b = Curve([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])
# Categories
lines_a = Curve([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])
ct_model = Python3Script(lines_a=lines_a, category_a="outer", lines_b=lines_b, category_b="inner")  # -> geo; inputs lines_a: list of Line, category_a: String, lines_b: list of Line, category_b: String
# ---------- ct_model: Python ----------
# venv: bit2beam_2026

from compas_rhino.conversions import line_to_compas
from compas_timber.connections import XLapJoint, TButtJoint, LButtJoint
from compas_timber.elements import Beam
from compas_timber.model import TimberModel

from timber_design.workflow import DirectRule, JointRuleSolver, TopologyRule, CategoryRule

width = 0.06
height = 0.08
z_vector = (0, 0, 1)

# ---------- RULE-BASED TIMBER MODEL WITH JOINTS ---------- #

model = TimberModel()

# lines_a, lines_b, category_a, category_b are provided as inputs
for line in lines_a:
    beam = Beam.from_centerline(line_to_compas(line), width, height, z_vector=z_vector)
    beam.attributes["category"] = category_a
    model.add_element(beam)

for line in lines_b:
    beam = Beam.from_centerline(line_to_compas(line), width, height, z_vector=z_vector)
    beam.attributes["category"] = category_b
    model.add_element(beam)

# Define rule for joints between category_a and category_b
rule1 = CategoryRule(TButtJoint, category_b, category_a)
rule2 = CategoryRule(XLapJoint, category_b, category_b)
rule3 = CategoryRule(LButtJoint, category_a, category_a)

# Use JointRuleSolver to apply rules
solver = JointRuleSolver([rule1, rule2, rule3])
solver.apply_rules_to_model(model)

model.process_joinery()

geo = [beam.geometry for beam in model.beams]
# ---------- end ct_model ----------
compas_draw_4 = COMPASDraw(cg=ct_model)  # -> rg; same code as compas_draw

# ----
# COMPAS Timber - Direct Joint
# Direct Joint Assignments
curve_3 = Curve([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])
ct_model_2 = Python3Script(lines=curve_3)  # -> geo; inputs lines: list of Line
# ---------- ct_model_2: Python ----------
# venv: bit2beam_2026

from compas_rhino.conversions import line_to_compas
from compas_timber.connections import XLapJoint
from compas_timber.elements import Beam
from compas_timber.model import TimberModel

width = 0.06
height = 0.08
z_vector = (0, 0, 1)

model = TimberModel()
for line in lines:
    line = line_to_compas(line)
    beam = Beam.from_centerline(centerline=line, width=width, height=height, z_vector=z_vector)
    model.add_element(beam)

beams = list(model.beams)
XLapJoint.create(model, beams[0], beams[1], False, cut_plane_bias=0.5)
XLapJoint.create(model, beams[1], beams[2], True, cut_plane_bias=0.5)
XLapJoint.create(model, beams[2], beams[0], True, cut_plane_bias=0.5)

model.process_joinery()

geo = []
for beam in model.beams:
    geo.append(beam.geometry)
# ---------- end ct_model_2 ----------
compas_draw_5 = COMPASDraw(cg=ct_model_2)  # -> rg
#   port cg: The COMPAS geometry or datastructure to be drawn.
#   port rg: The Rhino geometry object.
# ---------- compas_draw_5: Python ----------
# venv: caadria_b01

"""
Draws COMPAS geometry in Grasshopper.
"""

from typing import Any

import Grasshopper

from compas.scene import SceneObject


class CompasToRhinoGeometry(Grasshopper.Kernel.GH_ScriptInstance):
    def RunScript(self, cg):
        if not cg:
            return None

        return SceneObject(item=cg).draw()
# ---------- end compas_draw_5 ----------

# ----
# COMPAS Timber - Joint Rules
# Direct Rules
lines = Curve([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])
ct_model_3 = Python3Script(lines=lines)  # -> geo; inputs lines: list of Line
# ---------- ct_model_3: Python ----------
# venv: bit2beam_2026

from compas_rhino.conversions import line_to_compas
from compas_timber.connections import XLapJoint, TButtJoint, LMiterJoint, JointTopology
from compas_timber.elements import Beam
from compas_timber.model import TimberModel

from timber_design.workflow import DirectRule, JointRuleSolver, TopologyRule, CategoryRule

width = 0.06
height = 0.08
z_vector = (0, 0, 1)

# ---------- TIMBER MODEL WITH DIRECT RULE-ASSIGNMENT ---------- #

model = TimberModel()

for line in lines:
    line = line_to_compas(line)
    beam = Beam.from_centerline(centerline=line, width=width, height=height, z_vector=z_vector)
    model.add_element(beam)

beams = list(model.beams)
# Direct rule assignment for specific beams
rules = [
    DirectRule(XLapJoint, [beams[0], beams[1]]),
    DirectRule(XLapJoint, [beams[1], beams[2]]),
    DirectRule(XLapJoint, [beams[2], beams[0]])
]

solver = JointRuleSolver(rules)
solver.apply_rules_to_model(model)

model.process_joinery()

geo = [beam.geometry for beam in model.beams]
# ---------- end ct_model_3 ----------
compas_draw_6 = COMPASDraw(cg=ct_model_3)  # -> rg; same code as compas_draw

# ----
# Topology
lines_a_2 = Curve([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])
lines_b_2 = Curve([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])
ct_model_4 = Python3Script(lines=[lines_a_2, lines_b_2])  # -> geo; inputs lines: list of Line
# ---------- ct_model_4: Python ----------
# venv: bit2beam_2026

from compas_rhino.conversions import line_to_compas
from compas_timber.connections import XLapJoint, TButtJoint, LMiterJoint, JointTopology
from compas_timber.elements import Beam
from compas_timber.model import TimberModel

from timber_design.workflow import DirectRule, JointRuleSolver, TopologyRule, CategoryRule

width = 0.06
height = 0.08
z_vector = (0, 0, 1)

# ----------- TOPOLOGICAL RULE-BASED TIMBER MODEL WITH JOINTS ---------- #

model = TimberModel()

for line in lines:
    line = line_to_compas(line)
    beam = Beam.from_centerline(centerline=line, width=width, height=height, z_vector=z_vector)
    model.add_element(beam)

# Define rules based on topology (X, T, and L joints)
rules = [
    TopologyRule(JointTopology.TOPO_X, XLapJoint),
    TopologyRule(JointTopology.TOPO_T, TButtJoint),
    TopologyRule(JointTopology.TOPO_L, LMiterJoint)
]

# Apply all rules using the solver
solver = JointRuleSolver(rules)
solver.apply_rules_to_model(model)

model.process_joinery()

geo = [beam.geometry for beam in model.beams]
# ---------- end ct_model_4 ----------
compas_draw_7 = COMPASDraw(cg=ct_model_4)  # -> rg; same code as compas_draw

# ----
# COMPAS Timber Model - From Lines
centerline_model = Line([Line((-3.509972934, -1.492152993, 2.22874718), (-3.509972934, -0.4188767486, 3.073171606)), Line((-3.509972934, -1.492152993, 2.22874718), (-2.4270184, -1.492152993, 3.073686963)), Line((-3.509972934, -0.1606205973, 3.23041945), (-2.161675054, -0.7695668304, 3.659802426)), Line((-3.509972934, -0.4188767486, 3.073171606), (-3.509972934, 0.9424020442, 3.701431926)), Line((-3.509972934, 1.253299248, 3.775463882), (-2.148966267, 0.3799502445, 4.128895601)), Line((-3.509972934, 0.9424020442, 3.701431926), (-3.509972934, 1.989048229, 3.84778377))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])
ct_from_lines = Python3Script(
    lines=centerline_model,
    beam_width=Slider(0.08, range=0..0.1),
    beam_height=Slider(0.1, range=0..0.1),
    process_joinery=Toggle(True))  # -> beams; inputs lines: list of Line, beam_width: Double, beam_height: Double, process_joinery: Boolean
# ---------- ct_from_lines: Python ----------
# venv: bit2beam_2026

from compas_rhino.devtools import DevTools
DevTools.ensure_path()

# --------------------------------------------------
# ------------------- YOUR CODE --------------------
from compas_rhino.conversions import line_to_compas
from lib_simple_timber_model import TimberModelCreator

lines = [line_to_compas(line) for line in lines]

creator = TimberModelCreator(lines, beam_width, beam_height)
timber_model = creator.create_timber_model(process_joinery=process_joinery)

beams = [beam.geometry for beam in timber_model.beams]
# ---------- end ct_from_lines ----------
compas_draw_8 = COMPASDraw(cg=ct_from_lines)  # -> rg; same code as compas_draw

# ----
# Note: Joints are nonsensical
toggle = BooleanToggle(True)
# COMPAS Timber Model - From Mesh
mesh = Mesh(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)
ct_from_mesh = Python3Script(mesh=mesh, beam_width=Slider(0.08, range=0..0.1), beam_height=Slider(0.1, range=0..0.1), process_joinery=toggle)  # -> beams; inputs mesh: Mesh, beam_width: Double, beam_height: Double, process_joinery: Boolean
# ---------- ct_from_mesh: Python ----------
# venv: bit2beam_2026

from compas_rhino.devtools import DevTools
DevTools.ensure_path()
print(DevTools.ensure_path())

# --------------------------------------------------
# ------------------- YOUR CODE --------------------
from lib_simple_timber_model import TimberModelCreator
from compas_rhino.conversions import mesh_to_compas

mesh = mesh_to_compas(mesh)

creator = TimberModelCreator.from_mesh(mesh, beam_width, beam_height)
timber_model = creator.create_timber_model(process_joinery=process_joinery)

beams = [beam.geometry for beam in timber_model.beams]
# ---------- end ct_from_mesh ----------
compas_draw_9 = COMPASDraw(cg=ct_from_mesh)  # -> rg; same code as compas_draw
